# Grasshopper definition mesh-to-fold.gh (Grasshopper 1.0.7)

# convert a Rhino mesh into a FOLD format mesh object.
# The output is given in two forms:
# - a FOLD object (string JSON format)
# - individual geometry arrays (Grasshopper Data Tree format)
mesh = Mesh(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)
mesh_2 = Mesh(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)
c_script = CSharpScript(M=mesh)  # -> FOLD, vertices_coords, edges_vertices, edges_faces, edges_assignment, edges_foldAngle, faces_vertices; inputs M: Mesh
# ---------- c_script: C# usings ----------
using System.Linq;
# ---------- c_script: C# ----------
    // build all arrays from Mesh's vertices and faces.
    List<Vector3d> vertices_coords_list = M.Vertices.Select(v => new Vector3d(v.X, v.Y, v.Z)).ToList();
    // Point3f[] vertices_coords_list = M.Vertices.ToArray();
    List<int[]> faces_vertices_list = MeshToFacesVertices(M);
    List<int[]> edges_vertices_list = FacesVerticesToEdgesVertices(faces_vertices_list);
    List<int[]> edges_faces_list = MakeEdgesFaces(edges_vertices_list, faces_vertices_list);
    List<double> edges_foldAngle_list = MakeEdgesFoldAngle(vertices_coords_list, edges_faces_list, faces_vertices_list);
    List<string> edges_assignment_list = EdgesFoldAngleToAssignment(edges_foldAngle_list, edges_faces_list);
    // encode data as a string (JSON) FOLD format.
    FOLD = MakeFoldJSON(vertices_coords_list,
      edges_vertices_list,
      edges_faces_list,
      edges_foldAngle_list,
      edges_assignment_list,
      faces_vertices_list);
    // expose each individual data array for the user, convert nested arrays to Grasshopper Trees
    vertices_coords = vertices_coords_list.ToArray();
    faces_vertices = GraphComponentToTree(faces_vertices_list);
    edges_vertices = GraphComponentToTree(edges_vertices_list);
    edges_faces = GraphComponentToTree(edges_faces_list);
    edges_foldAngle = edges_foldAngle_list.ToArray();
    edges_assignment = edges_assignment_list.ToArray();
# ---------- c_script: C# additional code ----------
  // only used in one place: to determine when adjacent faces are coplanar ("flat" crease between them)
  const double FLAT_CREASE_EPSILON = 0.001;

  /// <summary>
  /// JSON string building methods
  /// </summary>
  Func<Vector3d, string> formatPoint = (p) => String.Format("[{0},{1},{2}]", p.X, p.Y, p.Z);
  Func<string, string> formatString = (s) => String.Format("\"{0}\"", s);
  Func<int[], string> formatIntArray = (arr) => "[" + String.Join(",", arr) + "]";
  // create JSON style string where "name" is the key and the component is a stringified array:
  // "name": [[0, 1], [5, 2], [3, 5], [4, 0]]
  string ArrayOfIntComponentJSONRow(List<int[]> component, string name) {
    return component.Count == 0 ? ""
      : String.Format("\"{0}\":", name) + "[" + String.Join(",", component.Select(formatIntArray)) + "]";
  }
  string PointComponentJSONRow(List<Vector3d> component, string name) {
    return component.Count == 0 ? ""
      : String.Format("\"{0}\":", name) + "[" + String.Join(",", component.Select(formatPoint)) + "]";
  }
  string DoubleComponentJSONRow(List<double> component, string name) {
    return component.Count == 0 ? ""
      : String.Format("\"{0}\":", name) + "[" + String.Join(",", component) + "]";
  }
  string StringComponentJSONRow(List<string> component, string name) {
    return component.Count == 0 ? ""
      : String.Format("\"{0}\":", name) + "[" + String.Join(",", component.Select(formatString)) + "]";
  }

  /// <summary>
  /// Create a FOLD format string out of FOLD data arrays.
  /// </summary>
  /// <returns>
  /// string, FOLD format (JSON) encoding of the data
  /// </returns>
  string MakeFoldJSON(List<Vector3d> vertices_coords,
    List<int[]> edges_vertices,
    List<int[]> edges_faces,
    List<double> edges_foldAngle,
    List<string> edges_assignment,
    List<int[]> faces_vertices)
  {
    // make a list of components, filter out the 0-Count lists (empty strings)
    // join them between "{ }" brackets to form a JSON.
    IEnumerable<string> componentRows = new List<string> {
        PointComponentJSONRow(vertices_coords, "vertices_coords"),
        ArrayOfIntComponentJSONRow(edges_vertices, "edges_vertices"),
        ArrayOfIntComponentJSONRow(edges_faces, "edges_faces"),
        StringComponentJSONRow(edges_assignment, "edges_assignment"),
        DoubleComponentJSONRow(edges_foldAngle, "edges_foldAngle"),
        ArrayOfIntComponentJSONRow(faces_vertices, "faces_vertices")
        }.Where(str => str != "")
      .Select(str => "\t" + str);
    return "{\n" + String.Join(",\n", componentRows) + "\n}";
  }

  /// <summary>
  /// Convert a C-style array of type int[][] into a Grasshopper DataTree.
  /// </summary>
  /// <param name="components">
  /// A jagged C-style int[][] array, such as edges_vertices or faces_edges
  /// </param>
  /// <returns>
  /// DataTree representation of the C-style int[][] array
  /// </returns>
  DataTree<int> GraphComponentToTree(List<int[]> components) {
    DataTree<int> tree = new DataTree<int>();
    for (int i = 0; i < components.Count; i++) {
      GH_Path path = new GH_Path(i);
      for (int j = 0; j < components[i].Length; j++) {
        tree.Add(components[i][j], path);
      }
    }
    return tree;
  }

  /// <summary>
  /// Create FOLD format faces_vertices data from a Rhino Mesh object.
  /// </summary>
  /// <param name="M">
  /// A Rhino-Common Mesh
  /// </param>
  /// <returns>
  /// the faces_vertices data of the mesh as a C-style int[][] array.
  /// </returns>
  Func<Mesh, List<int[]>> MeshToFacesVertices = (M) => M.Faces.Select(face => {
    int[] quad = { face.A, face.B, face.C, face.D };
    int[] triangle = { face.A, face.B, face.C };
    return face.IsQuad ? quad : triangle;
    }).ToList();

  /// <summary>
  /// Make one point for every face at the center of the face (average of the face's vertices).
  /// </summary>
  /// <returns>Vector3d[] array of face center points</returns>
  Func<List<Vector3d>, List<int[]>, List<Vector3d>> MakeFacesCenter = (vertices_coords, faces_vertices) => faces_vertices
    .Select(vertices => {
    Vector3d center = Vector3d.Zero;
    for (int i = 0; i < vertices.Length; i++) {
      center += vertices_coords[vertices[i]];
    }
    double scale = 1.0 / Math.Max(1, vertices.Length);
    return center * scale;
    }).ToList();

  /// <summary>
  /// This calculates the normal for every face using vertices_coords as a coordinate reference,
  /// assuming every face is at least a triangle, and faces do not include three or more collinear vertices.
  /// todo: This is a big assumption, we should be able to walk around a face until we get a valid result if
  /// we encounter a degenerate cross product.
  /// </summary>
  /// <returns></returns>
  Func<List<Vector3d>, List<int[]>, List<Vector3d>> MakeFacesNormal = (vertices_coords, faces_vertices) => faces_vertices
    .Select(vertices => new List<int>(vertices).Select(vertex => vertices_coords[vertex]).ToList())
    .Select(polygon => {
    // cross product unit vectors from point 0 to point 1 and 2.
    // as long as the face winding data is consistent, this gives consistent face normals
    Vector3d a = (polygon[1] - polygon[0]);
    Vector3d b = (polygon[2] - polygon[0]);
    a.Unitize();
    b.Unitize();
    return Vector3d.CrossProduct(a, b);
    }).ToList();

  /// <summary>
  /// Create FOLD format edges_vertices data from faces_vertices data.
  /// </summary>
  /// <param name="faces_vertices">
  /// A mesh's faces_vertices data (result of calling MeshToFacesVertices)
  /// </param>
  /// <returns>
  /// The edges_vertices data of the mesh as a C-style int[][] array.
  /// </returns>
  List<int[]> FacesVerticesToEdgesVertices(List<int[]> faces_vertices) {
    List<int[]> edges_vertices = new List<int[]>();
    // prevent creating repeats of edges from neighboring faces.
    // "foundKeys" contains pairs of vertices, always ordered with the smaller index first.
    Dictionary<string, bool> visitedVertices = new Dictionary<string, bool>();
    // walk around every face, creating an edge from pairs of neighboring vertices.
    for (int i = 0; i < faces_vertices.Count; i++) {
      for (int j = 0; j < faces_vertices[i].Length; j++) {
        // consult the dictionary of visited vertex pairs, skip this edge if we already found it.
        int v1 = faces_vertices[i][j];
        int v2 = faces_vertices[i][(j + 1) % faces_vertices[i].Length];
        string key = v1 < v2
          ? String.Format("{0} {1}", v1, v2)
          : String.Format("{0} {1}", v2, v1);
        if (visitedVertices.ContainsKey(key)) { continue; }
        // add edge, and add these vertices to the visited vertex pair dictionary.
        visitedVertices.Add(key, true);
        int[] edge_vertices = { v1, v2 };
        edges_vertices.Add(edge_vertices);
      }
    }
    return edges_vertices;
  }

  /// <summary>
  /// This dictionary takes a space-separated pair of vertices "3 10" and returns the edge connecting them.
  /// </summary>
  /// <param name="edges_vertices"></param>
  /// <returns></returns>
  Dictionary<string, int> MakeEdgeLookupFromVertices(List<int[]> edges_vertices) {
    Dictionary<string, int> lookup = new Dictionary<string, int>();
    for (int i = 0; i < edges_vertices.Count; i++) {
      string key1 = String.Format("{0} {1}", edges_vertices[i][0], edges_vertices[i][1]);
      string key2 = String.Format("{0} {1}", edges_vertices[i][1], edges_vertices[i][0]);
      lookup.Add(key1, i);
      lookup.Add(key2, i);
    }
    return lookup;
  }

  /// <summary>
  /// given edges_vertices and faces_vertices, make edges_faces which gives all neighboring faces for each edge.
  /// </summary>
  /// <param name="edges_vertices"></param>
  /// <param name="faces_vertices"></param>
  /// <returns></returns>
  List<int[]> MakeEdgesFaces(List<int[]> edges_vertices, List<int[]> faces_vertices) {
    // create an empty List of List for every edge.
    List<List<int>> edges_faces = new List<List<int>>();
    for (int e = 0; e < edges_vertices.Count; e++) {
      edges_faces.Add(new List<int>());
    }
    // using a vertex-lookup, walk around every face taking pairs of neighboring vertices,
    // "3 12" for example, and query the lookup to get the edge, Add this face to that edge's list.
    Dictionary<string, int> edgeLookup = MakeEdgeLookupFromVertices(edges_vertices);
    for (int f = 0; f < faces_vertices.Count; f++) {
      for (int j = 0; j < faces_vertices[f].Length; j++) {
        int v1 = faces_vertices[f][j];
        int v2 = faces_vertices[f][(j + 1) % faces_vertices[f].Length];
        string key = String.Format("{0} {1}", v1, v2);
        int edge = edgeLookup[key];
        edges_faces[edge].Add(f);
      }
    }
    return edges_faces.Select(list => list.ToArray()).ToList();
  }

  /// <summary>
  /// Use edges_foldAngle to determine assignment:
  /// "B" naked edges, "F" 0 angle, "V" positive angle, "M" negative angle.
  /// </summary>
  /// <param name="edges_foldAngle"></param>
  /// <param name="edges_faces"></param>
  /// <returns></returns>
  Func<List<double>, List<int[]>, List<string>> EdgesFoldAngleToAssignment = (edges_foldAngle, edges_faces) => edges_foldAngle
    .Select((foldAngle, i) => {
    if (edges_faces[i].Length < 2) { return "B"; }
    if (Math.Abs(foldAngle) < FLAT_CREASE_EPSILON) { return "F"; }
    return foldAngle < 0 ? "M" : "V";
    }).ToList();

  /// <summary>
  /// This calculates the 180-Dihedral angle between two faces (0 angle means co-planar).
  /// </summary>
  /// <returns></returns>
  List<double> MakeEdgesFoldAngle(List<Vector3d> vertices_coords, List<int[]> edges_faces, List<int[]> faces_vertices) {
    List<Vector3d> faces_normal = MakeFacesNormal(vertices_coords, faces_vertices);
    List<Vector3d> faces_center = MakeFacesCenter(vertices_coords, faces_vertices);
    // get the angle between two adjacent face normals, where parallel normals have 0 angle.
    // additionally, create a vector from one face's center to the other and check the sign of
    // the dot product with one of the normals, this clarifies if the fold is mountain or valley.
    return edges_faces.Select(faces => {
      if (faces.Length < 2) { return 0.0; }
      Vector3d a = faces_normal[faces[0]];
      Vector3d b = faces_normal[faces[1]];
      Vector3d a2b = faces_center[faces[1]] - faces_center[faces[0]];
      a2b.Unitize();
      // for mountain creases (faces facing away from each other), set the sign to negative.
      double sign = Math.Sign(Vector3d.Multiply(a, a2b));
      return (Vector3d.VectorAngle(a, b) * 180 / Math.PI) * sign;
      }).ToList();
  }
# ---------- end c_script ----------

# ----
# FOLD file
panel = Panel(c_script.FOLD)

# ----
# vertices
# edges
# faces
panel_2 = Panel(c_script.vertices_coords)
panel_3 = Panel(c_script.edges_vertices)
panel_4 = Panel(c_script.edges_faces)
panel_5 = Panel(c_script.edges_assignment)
panel_6 = Panel(c_script.edges_foldAngle)
# compile individual FOLD object component
# arrays into a single FOLD object.
# This is a subprocess of the previous component.
panel_7 = Panel(c_script.faces_vertices)

c_script_2 = CSharpScript(
    vertices_coords=c_script.vertices_coords,
    edges_vertices=c_script.edges_vertices,
    edges_faces=c_script.edges_faces,
    edges_assignment=c_script.edges_assignment,
    edges_foldAngle=c_script.edges_foldAngle,
    faces_vertices=c_script.faces_vertices)  # -> FOLD; inputs vertices_coords: list of Vector3d, vertices_vertices: tree of Int32, edges_vertices: tree of Int32, edges_faces: tree of Int32, edges_assignment: list of String, edges_foldAngle: list of Double, faces_vertices: tree of Int32, faces_edges: tree of Int32
# ---------- c_script_2: C# ----------
    List<int[]> vertices_vertices_list = TreeToArrayOfArrayOfInt(vertices_vertices);
    List<int[]> edges_vertices_list = TreeToArrayOfArrayOfInt(edges_vertices);
    List<int[]> edges_faces_list = TreeToArrayOfArrayOfInt(edges_faces);
    List<int[]> faces_vertices_list = TreeToArrayOfArrayOfInt(faces_vertices);
    List<int[]> faces_edges_list = TreeToArrayOfArrayOfInt(faces_edges);
    FOLD = MakeFoldJSON(vertices_coords,
      vertices_vertices_list,
      edges_vertices_list,
      edges_faces_list,
      edges_foldAngle,
      edges_assignment,
      faces_vertices_list,
      faces_edges_list);
# ---------- c_script_2: C# additional code ----------
  /// <summary>
  /// Convert a Grasshopper Tree two levels deep with integers into a List<int[]> type (List of arrays of ints)
  /// </summary>
  /// <param name="tree">Grasshopper data tree containing branches of lists of integers</param>
  /// <returns>A C# List type conversion of a DataTree with type List<int[]>() </returns>
  List<int[]> TreeToArrayOfArrayOfInt(DataTree<int> tree) {
    List<int[]> result = new List<int[]>();
    for (int i = 0; i < tree.BranchCount; i++) {
      result.Add(new int[tree.Branches[i].Count]);
      for (int j = 0; j < tree.Branches[i].Count; j++) {
        result[i][j] = tree.Branches[i][j];
      }
    }
    return result;
  }

  /// <summary>
  /// JSON string building methods
  /// </summary>
  Func<Vector3d, string> formatPoint = (p) => String.Format("[{0},{1},{2}]", p.X, p.Y, p.Z);
  Func<string, string> formatString = (s) => String.Format("\"{0}\"", s);
  Func<int[], string> formatIntArray = (arr) => "[" + String.Join(",", arr) + "]";
  // create JSON style string where "name" is the key and the component is a stringified array:
  // "name": [[0, 1], [5, 2], [3, 5], [4, 0]]
  string ArrayOfIntComponentJSONRow(List<int[]> component, string name) {
    return component.Count == 0 ? ""
      : String.Format("\"{0}\":", name) + "[" + String.Join(",", component.Select(formatIntArray)) + "]";
  }
  string PointComponentJSONRow(List<Vector3d> component, string name) {
    return component.Count == 0 ? ""
      : String.Format("\"{0}\":", name) + "[" + String.Join(",", component.Select(formatPoint)) + "]";
  }
  string DoubleComponentJSONRow(List<double> component, string name) {
    return component.Count == 0 ? ""
      : String.Format("\"{0}\":", name) + "[" + String.Join(",", component) + "]";
  }
  string StringComponentJSONRow(List<string> component, string name) {
    return component.Count == 0 ? ""
      : String.Format("\"{0}\":", name) + "[" + String.Join(",", component.Select(formatString)) + "]";
  }

  /// <summary>
  /// Create a FOLD format string out of FOLD data arrays.
  /// </summary>
  /// <returns>
  /// string, FOLD format (JSON) encoding of the data
  /// </returns>
  string MakeFoldJSON(List<Vector3d> vertices_coords,
    List<int[]> vertices_vertices,
    List<int[]> edges_vertices,
    List<int[]> edges_faces,
    List<double> edges_foldAngle,
    List<string> edges_assignment,
    List<int[]> faces_vertices,
    List<int[]> faces_edges)
  {
    // make a list of components, filter out the 0-Count lists (empty strings)
    // join them between "{ }" brackets to form a JSON.
    IEnumerable<string> componentRows = new List<string> {
        PointComponentJSONRow(vertices_coords, "vertices_coords"),
        ArrayOfIntComponentJSONRow(vertices_vertices, "vertices_vertices"),
        ArrayOfIntComponentJSONRow(edges_vertices, "edges_vertices"),
        ArrayOfIntComponentJSONRow(edges_faces, "edges_faces"),
        StringComponentJSONRow(edges_assignment, "edges_assignment"),
        DoubleComponentJSONRow(edges_foldAngle, "edges_foldAngle"),
        ArrayOfIntComponentJSONRow(faces_vertices, "faces_vertices"),
        ArrayOfIntComponentJSONRow(faces_edges, "faces_edges"),
        }.Where(str => str != "")
      .Select(str => "\t" + str);
    return "{\n" + String.Join(",\n", componentRows) + "\n}";
  }
# ---------- end c_script_2 ----------

# ----
# FOLD file
panel_8 = Panel(c_script_2)
